% Simulink data dictionary rev3_data.sldd

MC_DC_State = enum(DefaultValue="Disabled")
  Disabled = 0
  Enabled = 1
  Speed_Check = 2
  Active = 3
  Complete = 4

MC_VSM_State = enum(DefaultValue="Start")
  Start = 0
  PC_Init = 1
  PC_Active = 2
  PC_Finish = 3
  Wait = 4
  Ready = 5
  Motor_Running = 6
  Fault = 7
  Shutdown = 14
  Recycle_Power = 15

BMS_Contactor_Command = enum(DefaultValue="Open_Contactor")
  Open_Contactor = 0
  Close_Contactor = 1
  Stay = 2

UC_State = enum(DefaultValue="Preset")
  Preset = 0
  Key_Cycle = 1
  MC_Off = 2
  LVSS_MC_Startup = 3
  MC_Init = 4
  Contactor_Closed = 5
  MC_Ready = 6
  Contactor_Open = 7
  MC_Discharging = 8
  LVSS_MC_Shutdown = 9
  MC_Active = 10
  Estop = 11
  Fault = 12
  Super_Fault = 13

VCU_Fault_Inputs_Bus = Simulink.Bus()
  Override_Ignition: boolean
  Ignition: boolean
  Override_ESTOP: boolean
  ESTOP: boolean
  Override_Brake: boolean
  Brake: int16
  Override_Forward_EN: boolean
  Forward_EN: boolean
  Override_Start: boolean
  Start: boolean
  Override_Throttle: boolean
  Throttle: int16
  Override_HIB_Comparison_Fault: boolean
  HIB_Comparison_Fault: boolean
  Override_Interlock: boolean
  Interlock: boolean
  Override_Inverter_Discharge_State: boolean
  Inverter_Discharge_State: Enum: MC_DC_State
  Override_VSM_State: boolean
  VSM_State: Enum: MC_VSM_State
  Override_LVSS_ON: boolean
  LVSS_ON: boolean
  Override_Contactor_Closed: boolean
  Contactor_Closed: boolean
  Override_Cell_Temps: boolean
  Cell_Temps: int16
  Override_Cell_Voltages: boolean
  Cell_Voltages: int16
  Override_Isolation_State: boolean
  Isolation_State: int8
  Override_MC_Speed_Out: boolean
  MC_Speed_Out: int16
  Override_Batt_Speed_Out: boolean
  Batt_Speed_Out: int16
  Override_Temperatures: boolean
  Temperatures: int16
  Override_MC_Flow_Rate: boolean
  MC_Flow_Rate: int16
  Override_Batt_Flow_Rate: boolean
  Batt_Flow_Rate: int16
  Override_HIB_ON: boolean
  HIB_ON: boolean
  Override_HUDL_ON: boolean
  HUDL_ON: boolean
  Override_TMS_ON: boolean
  TMS_ON: boolean
  Override_GUB_ON: boolean
  GUB_ON: boolean
  Override_Acc_ON: boolean
  Acc_ON: boolean
  Override_Batt_12V_ON: boolean
  Batt_12V_ON: boolean
  Override_Vicor_Current: boolean
  Vicor_Current: int16
  Override_LVSS_Temps: boolean
  LVSS_Temps: int16
  Override_LVSS_Currents: boolean
  LVSS_Currents: int16
  Override_Heartbeats: boolean
  Heartbeats: int16
  Override_MC_12V0: boolean
  MC_12V0: boolean
  Override_LVSS_EN: boolean
  LVSS_EN: boolean
  Override_nReset: boolean
  nReset: boolean
  Override_Watchdog: boolean
  Watchdog: boolean
  Override_uC_State: boolean
  uC_State: Enum: UC_State
  Override_HB_Feedback: boolean
  HB_Feedback: boolean
  Override_HM_Fault: boolean
  HM_Fault: boolean
  Override_Direction_Command: boolean
  Direction_Command: boolean
  Override_Rolling_Counter: boolean
  Rolling_Counter: int8
  Override_Speed_Command: boolean
  Speed_Command: int16
  Override_Speed_Mode_Enable: boolean
  Speed_Mode_Enable: boolean
  Override_Torque_Limit_Command: boolean
  Torque_Limit_Command: int16
  Override_LS_Self_Test: boolean
  LS_Self_Test: boolean
  Override_MC_Self_Test: boolean
  MC_Self_Test: boolean
  Override_State_Handshake: boolean
  State_Handshake: boolean
  Override_LVSS_EN_Override: boolean
  LVSS_EN_Override: boolean
  Override_MC_EN_Override: boolean
  MC_EN_Override: boolean
  Override_CAN_Override: boolean
  CAN_Override: boolean
  Override_Wheel_Speed: boolean
  Wheel_Speed: int16

BMS_Fault_Inputs_Bus = Simulink.Bus()
  BMS_EN: boolean
  Override_BMS_EN: boolean
  BMS_Contactor_State: Enum: BMS_Contactor_Command
  Override_BMS_Contactor_State: boolean
  Contactor_Closed: boolean
  Override_Contactor_Closed: boolean
  Cell_Temps: int16
  Override_Cell_Temps: boolean
  Cell_Voltages: int16
  Override_Cell_Voltages: boolean

GFDB_Fault_Inputs_Bus = Simulink.Bus()
  GFDB_EN: boolean
  Override_GFDB_EN: boolean
  Isolation_State: uint8
  Override_Isolation_State: boolean

TMS_Fault_Inputs_Bus = Simulink.Bus()
  TMS_EN: boolean
  Override_TMS_EN: boolean
  MC_Speed: int16
  Override_MC_Speed: boolean
  Batt_Speed: int16
  Override_Batt_Speed: boolean
  Temperatures: int16
  Override_Temperatures: boolean
  Batt_Flow_Rate: int16
  Override_Batt_Flow_Rate: boolean
  MC_Flow_Rate: int16
  Override_MC_Flow_Rate: boolean

HIB_Fault_Inputs_Bus = Simulink.Bus()
  HIB_EN: boolean
  Override_HIB_EN: boolean
  Throttle: int16
  Override_Throttle: boolean
  Brake: int16
  Override_Brake: boolean
  Start: boolean
  Override_Start: boolean
  Forward_EN: boolean
  Override_Forward_EN: boolean
  Comparison_Error_Count: int8
  Override_Comparison_Error_Count: boolean
  Acceptable_Margin_Error_Count: int8
  Override_Acceptable_Margin_Error_Count: boolean
  Precision_Margin_Error_Count: int8
  Override_Precision_Margin_Error_Count: boolean

LVSS_Fault_Inputs_Bus = Simulink.Bus()
  LVSS_EN: boolean
  Override_LVSS_EN: boolean
  TMS_EN: boolean
  Override_TMS_EN: boolean
  GUB_EN: boolean
  Override_GUB_EN: boolean
  HIB_EN: boolean
  Override_HIB_EN: boolean
  HUDL_EN: boolean
  Override_HUDL_EN: boolean
  Acc_EN: boolean
  Override_Acc_EN: boolean
  Batt_12V_EN: boolean
  Override_Batt_12V_EN: boolean
  Vicor_Current: int16
  Override_Vicor_Current: boolean
  TMS_Temp: int16
  Override_TMS_Temp: boolean
  TMS_Current: int16
  Override_TMS_Current: boolean
  HIB_Temp: int16
  Override_HIB_Temp: boolean
  HIB_Current: int16
  Override_HIB_Current: boolean
  HUDL_Temp: int16
  Override_HUDL_Temp: boolean
  HUDL_Current: int16
  Override_HUDL_Current: boolean
  GUB_Temp: int16
  Override_GUB_Temp: boolean
  GUB_Current: int16
  Override_GUB_Current: boolean
  Batt_12V_Temp: int16
  Override_Batt_12V_Temp: boolean
  Batt_12V_Current: int16
  Override_Batt_12V_Current: boolean
  Acc_Temp: int16
  Override_Acc_Temp: boolean
  Acc_Current: int16
  Override_Acc_Current: boolean
  LVSS_Currents: int16
  Override_LVSS_Currents: boolean
  LVSS_Temps: int16
  Override_LVSS_Temps: boolean

IMU_Fault_Inputs_Bus = Simulink.Bus()
  Wheel_Speed: int16
  Override_Wheel_Speed: boolean
  Acc_EN: boolean
  Override_Acc_EN: boolean

LVSS_Outputs_Bus = Simulink.Bus()
  HIB_Power: boolean
  HUDL_Power: boolean
  TMS_Power: boolean
  GUB_Power: boolean
  Acc_Power: boolean
  Batt_12V_Power: boolean

BMS_Feedback_Bus = Simulink.Bus()
  BMS_Heartbeat: uint32
  Cell_Voltages: int16[1 100]
  Cell_Temps: int16[1 45]
  Contactor_Closed: boolean

TMS_Feedback_Bus = Simulink.Bus()
  Batt_Flow_Rate: int16
  MC_Flow_Rate: int16
  TMS_Heartbeat: uint32
  Temperatures: uint32[1 5]
  Batt_Speed_Out: uint8
  MC_Speed_Out: uint8

GFDB_Feedback_Bus = Simulink.Bus()
  Isolation_State: uint8
  GFDB_Heartbeat: uint32

WSS_Feedback_Bus = Simulink.Bus()
  WSS_Heartbeat: uint32

LVSS_Feedback_Bus = Simulink.Bus()
  HIB_ON: boolean
  HUDL_ON: boolean
  TMS_ON: boolean
  GUB_ON: boolean
  Acc_ON: boolean
  Batt_12V_ON: boolean
  LVSS_ON: boolean
  Vicor_Current: int16
  LVSS_Temps: int16[1 6]
  LVSS_Currents: int16[1 6]
  LVSS_Heartbeat: uint32

MC_Feedback_Bus = Simulink.Bus()
  D1_VSM_State: Enum: MC_VSM_State
  D4_Inverter_Discharge_State: Enum: MC_DC_State

No_HIB_Bus = Simulink.Bus()
  Key_In: boolean
  Estop_In: boolean

Yes_HIB_Bus = Simulink.Bus()
  Forward_EN: boolean
  Start: boolean
  Brake: int16
  Throttle: int16
  Steering_Angle: int16

Rider_Input_Bus = Simulink.Bus()
  No_HIB: Bus: No_HIB_Bus
  Yes_HIB: Bus: Yes_HIB_Bus

Key_In_Bus = Simulink.Bus()
  LS_A: boolean
  LS_B: boolean

Estop_In_Bus = Simulink.Bus()
  LS_A: boolean
  LS_B: boolean

Rider_Inputs_VCU_Bus = Simulink.Bus()
  Key_In: Bus: Key_In_Bus
  Estop_In: Bus: Estop_In_Bus
  Brake: int16
  Forward_EN: boolean
  Start: boolean
  Throttle: int16

MC_Feedback_VCU_Bus = Simulink.Bus()
  D4_Inverter_Discharge_State: Enum: MC_DC_State
  D1_VSM_State: Enum: MC_VSM_State

GFDB_Feedback_VCU_Bus = Simulink.Bus()
  Isolation_State: uint8

TMS_Feedback_VCU_Bus = Simulink.Bus()
  MC_Speed_Out: uint8
  Batt_Speed_Out: uint8
  Temperatures: uint32[1 5]
  MC_Flow_Rate: int16
  Batt_Flow_Rate: int16

BMS_Feedback_VCU_Bus = Simulink.Bus()
  Contactor_Closed: boolean
  Cell_Temps: int16[1 45]
  Cell_Voltages: int16[1 100]

LVSS_Feedback_VCU_Bus = Simulink.Bus()
  LVSS_ON: boolean
  HIB_ON: boolean
  GUB_ON: boolean
  TMS_ON: boolean
  HUDL_ON: boolean
  Acc_ON: boolean
  Batt_12V_ON: boolean
  LVSS_Currents: int16[1 6]
  LVSS_Temps: int16[1 6]
  Vicor_Current: int16

Internal_Feedback_MCuC_Bus = Simulink.Bus()
  MC_12V0: boolean
  LVSS_EN_uC: boolean
  nReset: boolean
  Watchdog: boolean
  uC_State: Enum: UC_State
  CAN_Override: boolean
  LVSS_EN_Override: boolean
  MC_EN_Override: boolean
  MC_Self_Test: boolean
  LS_Self_Test: Bus: LS_Self_Test_Bus
  State_Handshake: boolean

Feedback_MCuC_Bus = Simulink.Bus()
  MC_Feedback: Bus: MC_Feedback_VCU_Bus
  LVSS_Feedback: Bus: LVSS_Feedback_VCU_Bus
  Internal_Feedback: Bus: Internal_Feedback_MCuC_Bus
  BMS_Feedback: Bus: BMS_Feedback_VCU_Bus
  GFDB_Feedback: Bus: GFDB_Feedback_VCU_Bus
  TMS_Feedback: Bus: TMS_Feedback_VCU_Bus
  Heartbeats: uint32[5]

HIB_Bus = Simulink.Bus()
  HIB_Comparison_Fault: boolean

Internal_Feedback_Hardmon_Bus = Simulink.Bus()
  MC_12V0: boolean
  LVSS_EN_uC: boolean
  nReset: boolean
  Watchdog: boolean
  uC_State: Enum: UC_State
  LS_Self_Test: Bus: LS_Self_Test_Bus

LS_Self_Test_Bus = Simulink.Bus()
  LS_A: boolean
  LS_B: boolean

Feedback_Hardmon_Bus = Simulink.Bus()
  MC_Feedback: Bus: MC_Feedback_VCU_Bus
  LVSS_Feedback: Bus: LVSS_Feedback_VCU_Bus
  Internal_Feedback: Bus: Internal_Feedback_Hardmon_Bus
  BMS_Feedback: Bus: BMS_Feedback_VCU_Bus
  GFDB_Feedback: Bus: GFDB_Feedback_VCU_Bus
  TMS_Feedback: Bus: TMS_Feedback_VCU_Bus
  Heartbeats: uint32[5]

Hardmon_Inputs_Bus = Simulink.Bus()
  Rider_Inputs: Bus: Rider_Inputs_VCU_Bus
  Feedback: Bus: Feedback_Hardmon_Bus
  HIB: Bus: HIB_Bus
  Interlock: boolean
  MC_Direction_Command: boolean
  MC_Rolling_Counter: int8
  MC_Speed_Command: int16
  MC_Speed_Mode_Enable: boolean
  MC_Torque_Limit_Command: int16

MCuC_Inputs_Bus = Simulink.Bus()
  Rider_Inputs: Bus: Rider_Inputs_VCU_Bus
  Feedback: Bus: Feedback_MCuC_Bus
  HIB: Bus: HIB_Bus
  Interlock: boolean
  MC_Direction_Command: boolean
  MC_Rolling_Counter: int8
  MC_Speed_Command: int16
  MC_Speed_Mode_Enable: boolean
  MC_Torque_Limit_Command: int16

WSS_Fault_Inputs_Bus = Simulink.Bus()
  Front_Wheel_Speed: int16
  Override_Front_Wheel_Speed: boolean
  Rear_Wheel_Speed: int16
  Override_Rear_Wheel_Speed: boolean
  Acc_EN: boolean
  Override_Acc_EN: boolean

INS_Fault_Inputs_Bus = Simulink.Bus()
  Acceleration_X: int16
  Override_Acceleration_X: boolean
  Acceleration_Y: int16
  Override_Acceleration_Y: boolean
  Acceleration_Z: int16
  Override_Acceleration_Z: boolean
  Ground_Speed: int16
  Override_Ground_Speed: boolean
  Yaw: int16
  Override_Yaw: boolean
  Pitch: int16
  Override_Pitch: boolean
  Roll: int16
  Override_Roll: boolean
  Roll_Rate: int16
  Override_Roll_Rate: boolean
  Pitch_Rate: int16
  Override_Pitch_Rate: boolean
  Yaw_Rate: int16
  Override_Yaw_Rate: boolean
  Acc_EN: boolean
  Override_Acc_EN: boolean

Fault_Inputs_Bus = Simulink.Bus()
  VCU: Bus: VCU_Fault_Inputs_Bus
  BMS: Bus: BMS_Fault_Inputs_Bus
  GFDB: Bus: GFDB_Fault_Inputs_Bus
  TMS: Bus: TMS_Fault_Inputs_Bus
  HIB: Bus: HIB_Fault_Inputs_Bus
  LVSS: Bus: LVSS_Fault_Inputs_Bus
  WSS: Bus: WSS_Fault_Inputs_Bus
  IMU: Bus: IMU_Fault_Inputs_Bus
  TCS: Bus: TCS_Fault_Inputs_Bus
  INS: Bus: INS_Fault_Inputs_Bus

INS_Feedback_Bus = Simulink.Bus()
  INS_Heartbeat: uint32

TCS_Feedback_Bus = Simulink.Bus()
  TCS_Heartbeat: uint32

Feedback_Bus = Simulink.Bus()
  LVSS_Feedback: Bus: LVSS_Feedback_Bus
  BMS_Feedback: Bus: BMS_Feedback_Bus
  TMS_Feedback: Bus: TMS_Feedback_Bus
  LVSS_Outputs: Bus: LVSS_Outputs_Bus
  GFDB_Feedback: Bus: GFDB_Feedback_Bus
  MC_Feedback: Bus: MC_Feedback_Bus
  WSS_Feedback: Bus: WSS_Feedback_Bus
  INS_Feedback: Bus: INS_Feedback_Bus
  TCS_Feedback: Bus: TCS_Feedback_Bus

TCS_Fault_Inputs_Bus = Simulink.Bus()
  Front_Wheel_Speed: int16
  Override_Front_Wheel_Speed: boolean
  Rear_Wheel_Speed: int16
  Override_Rear_Wheel_Speed: boolean
  VCU_Torque_Command: int16
  Override_VCU_Torque_Command: boolean
  VCU_Fault_To_MC: boolean
  Override_VCU_Fault_To_MC: boolean
  VCU_Shutdown: boolean
  Override_VCU_Shutdown: boolean
  Acceleration_X: int16
  Override_Acceleration_X: boolean
  Acceleration_Y: int16
  Override_Acceleration_Y: boolean
  Acceleration_Z: int16
  Override_Acceleration_Z: boolean
  Ground_Speed: int16
  Override_Ground_Speed: boolean
  Yaw: int16
  Override_Yaw: boolean
  Pitch: int16
  Override_Pitch: boolean
  Roll: int16
  Override_Roll: boolean
  Roll_Rate: int16
  Override_Roll_Rate: boolean
  Pitch_Rate: int16
  Override_Pitch_Rate: boolean
  Yaw_Rate: int16
  Override_Yaw_Rate: boolean
  Acc_EN: boolean
  Override_Acc_EN: boolean